# Grasshopper definition curved_slat_divider_wall.gh (Grasshopper 1.0.8)
# plug-ins: Pufferfish

slat_wall_height = Slider(2000, range=0..2000)
slat_spacing = Slider(67, range=0..200)
slat_depth = Slider(120, range=0..250)
slat_rotation = Slider(0, range=0..90)
slat_thickness = Slider(19, range=0..30)
plate_thickness = Slider(19, range=0..30)

# ---- group: Snippet Group
wire_display = ValueList({"default": 0, "faint": 1, "hidden": 2}, selected="hidden")
py_toggle_wires = Python3Script(setting=wire_display)  # -> out, a; inputs setting: Int32
# ---------- py_toggle_wires: Python ----------
import Grasshopper as gh
import scriptcontext as sc

def switch_wire_display(display_setting, gh_object):
    if not isinstance(gh_object, gh.Kernel.Parameters.Param_GenericObject):
        return

    sources = list(gh_object.Sources)
    for source in sources:
        if not isinstance(source, gh.Kernel.Parameters.Param_GenericObject):
            return
    
    gh_object.WireDisplay = gh.Kernel.GH_ParamWireDisplay(display_setting)

def set_data_param_display(gh_object):
    if not isinstance(gh_object, gh.Kernel.Parameters.Param_GenericObject):
        return
    gh_object.IconDisplayMode = gh.Kernel.GH_IconDisplayMode.name

def main(setting):
    gh_document = ghenv.Component.OnPingDocument()

    for gh_object in gh_document.Objects:
        switch_wire_display(setting, gh_object)
        set_data_param_display(gh_object)

main(setting)
# ---------- end py_toggle_wires ----------
py_set_initial_wires = Python3Script()  # -> out, a
# ---------- py_set_initial_wires: Python ----------
import scriptcontext as sc
import Grasshopper as gh

def initialize_wires():
    gh_document = ghenv.Component.OnPingDocument()

    for gh_object in gh_document.Objects:
        if gh_object.NickName != "Wire Display":
            continue
        gh_object.SelectItem(0)

initialize_wires()
# ---------- end py_set_initial_wires ----------

# ----
crv_bottom_wall = Geometry(<curve referenced from the Rhino model>)
slat_depth_2 = Data(slat_depth)
slat_thickness_2 = Data(slat_thickness)
slat_rotation_2 = Data(slat_rotation)
slat_spacing_2 = Data(slat_spacing)
plate_thickness_2 = Data(plate_thickness)
slat_wall_height_2 = Data(slat_wall_height)
crv_wall_base = Data(crv_bottom_wall)

# ---- group: Create Top Wall Rail
slat_wall_height_3 = Data(slat_wall_height_2)
crvs_wall_profile_bot = Data(crv_wall_base)
move_vec = MoveVec(G=crvs_wall_profile_bot, X=0, Y=0, Z=slat_wall_height_3)  # -> G_2, X_2, V
crvs_wall_profile_top = Data(move_vec.G_2)

# ----
crvs_wall_profile_bot_2 = Data(crv_wall_base)
slat_depth_3 = Data(slat_depth_2)
plate_thickness_3 = Data(plate_thickness_2)
opening_height = Data(slat_wall_height_2)
xy = XYPlane(Origin=Point(0, 0, 0))
neg = Negative(Value=slat_depth_3)
offcrv = OffsetCurve(Curve=crvs_wall_profile_bot_2, Plane=xy, Distance=neg, BothSides=0, Kinks=0, CapType=1)
srf = Surface(offcrv)
eval = Evaluate(E="x-y", x=opening_height, y=plate_thickness_3)
Z = UnitZ(Factor=plate_thickness_3)
extr = Extrude(Base=srf, Direction=Z)
move_vec_2 = MoveVec(G=extr, X=0, Y=0, Z=eval)  # -> G_2, X_2, V
entwine = Entwine(Branch00=extr, Branch01=move_vec_2.G_2, FlattenInputs=True)  # -> flatten(Result)
breps_header_footer = Data(entwine)

plate_thickness_4 = Data(plate_thickness_2)
update_geo = BooleanToggle(True)

signage_base_layer = Panel("Render::MDF::Rails")
breps_header_footer_2 = Data(breps_header_footer)
update_geo_2 = Data(update_geo)
object = ModelObject(Geometry=breps_header_footer_2, Layer=signage_base_layer)  # -> Object, Geometry, Name, Layer, Visibility, Display, Drafting, Render
cache = ContentCache(Content=object.Object, Action=update_geo_2)

# ---- group: Divide Curve by slat position
crvs_wall_profile_bot_3 = Data(crv_wall_base)
slat_spacing_3 = Data(slat_spacing_2)
slat_thickness_3 = Data(slat_thickness_2)
plate_thickness_5 = Data(plate_thickness_2)
neg_2 = Negative(Value=slat_thickness_3)

# ----
move_vec_3 = MoveVec(G=crvs_wall_profile_bot_3, X=0, Y=0, Z=plate_thickness_5)  # -> G_2, X_2, V

# ---- group: Divide Curve by slat position (continued)
ext = ExtendCurve(Curve=move_vec_3.G_2, Type=0, Start=neg_2, End=neg_2)
len = Length(Curve=ext)
division = Division(A=len, B=slat_spacing_3)
roundf = RoundToFactor(NumberX=division, Factor="2", RoundType=0)  # -> Rounded, Difference, MultiplierR, MultiplierX
divide = DivideCurve(Curve=ext, Count=roundf.Rounded, Kinks=False)  # -> Points, Tangents, Parameters
crv_bound_wall_bot = Data(move_vec_3.G_2)
pts_slat_base = Data(divide.Points)

# ---- group: Create Slat Planes
crv_bound_wall_bot_2 = Data(crv_bound_wall_bot)
pts_slat_base_2 = Data(pts_slat_base)
slat_thickness_4 = Data(slat_thickness_2)
slat_depth_4 = Data(slat_depth_2)
slat_rotation_3 = Data(slat_rotation_2)
crv_cp = CurveClosestPoint(Point=pts_slat_base_2, Curve=crv_bound_wall_bot_2)  # -> Point, Parameter, Distance
eval_2 = EvaluateCurve(Curve=crv_bound_wall_bot_2, Parameter=crv_cp.Parameter)  # -> Point, Tangent, Angle
Z_2 = UnitZ(Factor=1)
xprod = CrossProduct(VectorA=Z_2, VectorB=eval_2.Tangent, Unitize=False)  # -> Vector, Length
neg_3 = Negative(Value=slat_depth_4)
pl = ConstructPlane(Origin=eval_2.Point, XAxis=eval_2.Tangent, YAxis=xprod.Vector)
deplane = DeconstructPlane(Plane=pl)  # -> Origin, XAxis, YAxis, ZAxis
division_2 = Division(A=slat_thickness_4, B="2")
neg_4 = Negative(Value=division_2)
amp = Amplitude(Vector=deplane.XAxis, Amplitude=neg_4)
addition = Addition(A=amp)
move = Move(Geometry=pl, Motion=addition)  # -> Geometry, Transform

# ----
rotate = Rotate(Geometry=move.Geometry, Angle=degrees(slat_rotation_3), Plane=move.Geometry)  # -> Geometry, Transform

# ---- group: Create Slat Planes (continued)
rectangle = Rectangle(Plane=rotate.Geometry, XSize=slat_thickness_4, YSize=slat_depth_4, Radius=0)  # -> Rectangle, Length
dispatch = Dispatch(List=rectangle.Rectangle, DispatchPattern=[True, False])  # -> ListA, ListB
rects_slat_base_full_height = Data(dispatch.ListA)
rects_slat_base_fill = Data(dispatch.ListB)

# ----
dispatch_2 = Dispatch(List=rotate.Geometry, DispatchPattern=[True, False])  # -> ListA, ListB
plns_slat_fill = Data(dispatch_2.ListB)
plns_slats = Data(dispatch_2.ListA)

rects_slat_base_full_height_2 = Data(rects_slat_base_full_height)
opening_height_2 = Data(slat_wall_height_2)
eval_3 = Evaluate(E="x-2*y", x=opening_height_2, y=plate_thickness_4)
Z_3 = UnitZ(Factor=eval_3)
srf_2 = Surface(rects_slat_base_full_height_2)
extr_2 = Extrude(Base=srf_2, Direction=Z_3)
breps_full_height_slats = Data(extr_2)

breps_trimmed_slats = Data(breps_full_height_slats)

signage_base_layer_2 = Panel("Render::MDF::Slats")
update_geo_3 = Data(update_geo)
object_2 = ModelObject(Geometry=breps_trimmed_slats, Layer=signage_base_layer_2)  # -> Object, Geometry, Name, Layer, Visibility, Display, Drafting, Render
cache_2 = ContentCache(Content=object_2.Object, Action=update_geo_3)

# ==== cluster MoveVec: Moves Geometry by X, Y, Z Components
X = ClusterInput()
Z = ClusterInput()
G = ClusterInput()
Y = ClusterInput()
vec = VectorXYZ(XComponent=X, YComponent=Y, ZComponent=Z)  # -> Vector, Length
move = Move(Geometry=G, Motion=vec.Vector)  # -> Geometry, Transform
X_2 = ClusterOutput(move.Transform)
G_2 = ClusterOutput(move.Geometry)
V = ClusterOutput(vec.Vector)
