# Grasshopper definition nature_boardwalk_gridshell.gh (Grasshopper 1.0.8)

pavilion_width_ft = Slider(40, range=0..80)
pavilion_height_ft = Slider(14, range=0..80)
pavilion_width_ft_2 = Slider(41.187, range=0..80)
gridshell_width = Slider(12, range=0..36)
gridshell_height = Slider(24, range=0..36)
pavilion_width_ft_3 = Data(pavilion_width_ft)
pavilion_length_ft = Data(pavilion_width_ft_2)
pavilion_height_ft_2 = Data(pavilion_height_ft)
gridshell_height_2 = Data(gridshell_height)
gridshell_width_2 = Data(gridshell_width)

# ---- group: Create Base Gridshell Curve
gridshell_width_3 = Data(gridshell_width_2)
gridshell_height_3 = Data(gridshell_height_2)
pt = ConstructPoint(XCoordinate=0, YCoordinate=0, ZCoordinate=0)
division = Division(A=gridshell_width_3, B="2")
division_2 = Division(A=gridshell_height_3, B="4")
neg = Negative(Value=division)
Y = UnitY(Factor=division_2)
X = UnitX(Factor=neg)
move = Move(Geometry=pt, Motion=Y)  # -> Geometry, Transform
move_2 = Move(Geometry=move.Geometry, Motion=X)  # -> Geometry, Transform
move_3 = Move(Geometry=move_2.Geometry, Motion=Y)  # -> Geometry, Transform
entwine = Entwine(Branch00=pt, Branch01=move.Geometry, Branch02=move_2.Geometry, Branch03=move_3.Geometry, FlattenInputs=True)  # -> flatten(Result)
xz = XZPlane(Origin=move_3.Geometry)
nurbs = NurbsCurve(Vertices=entwine, Degree=3, Periodic=False)  # -> Curve, Length, Domain
mirror = Mirror(Geometry=nurbs.Curve, Plane=xz)  # -> Geometry, Transform
entwine_2 = Entwine(Branch00=nurbs.Curve, Branch01=mirror.Geometry, FlattenInputs=True)  # -> flatten(Result)
yz = YZPlane(Origin=pt)
join = JoinCurves(Curves=entwine_2, Preserve=False)
mirror_2 = Mirror(Geometry=join, Plane=yz)  # -> Geometry, Transform
entwine_3 = Entwine(Branch00=join, Branch01=mirror_2.Geometry, FlattenInputs=True)  # -> flatten(Result)
join_2 = JoinCurves(Curves=entwine_3, Preserve=False)
crv_base = Data(join_2)

# ---- group: Create Canopy Surface
pavilion_width_ft_4 = Data(pavilion_width_ft_3)
pavilion_height_ft_3 = Data(pavilion_height_ft_2)
multiplication = Multiplication(A=pavilion_width_ft_4, B="12")
pt_2 = ConstructPoint(XCoordinate=0, YCoordinate=0, ZCoordinate=0)
multiplication_2 = Multiplication(A=pavilion_height_ft_3, B="12")
division_3 = Division(A=multiplication, B="2")
X_2 = UnitX(Factor=multiplication)
X_3 = UnitX(Factor=division_3)
move_4 = Move(Geometry=pt_2, Motion=X_2)  # -> Geometry, Transform
Z = UnitZ(Factor=multiplication_2)
move_5 = Move(Geometry=pt_2, Motion=X_3)  # -> Geometry, Transform
move_6 = Move(Geometry=move_5.Geometry, Motion=Z)  # -> Geometry, Transform
pavilion_length_ft_2 = Data(pavilion_length_ft)
arc = Arc3Pt(PointA=pt_2, PointB=move_6.Geometry, PointC=move_4.Geometry)  # -> Arc, Plane, Radius
multiplication_3 = Multiplication(A=pavilion_length_ft_2, B="12")
Y_2 = UnitY(Factor=multiplication_3)
extr = Extrude(Base=arc.Arc, Direction=Y_2)
srf_canopy = Data(extr)

# ----
count_v = Slider(7, range=0..15)
count_u = Slider(10, range=0..15)
srf_canopy_2 = Data(srf_canopy)
crv_base_2 = Data(crv_base)
count_u_2 = Data(count_u)
count_v_2 = Data(count_v)
dedom2 = DeconstructDomain²(Domain=srf_canopy_2)  # -> UComponent, VComponent
bbox = BoundingBox(Content=crv_base_2, Plane=PlaneXY(0, 0, 0))  # -> Box, Box_2
div = DivideDomain(Domain=dedom2.VComponent, Count=count_v_2)
div_2 = DivideDomain(Domain=dedom2.UComponent, Count=count_u_2)  # -> graft(Segments)
srf = Surface(bbox.Box)
dom² = ConstructDomain²(DomainU=div_2, DomainV=div)
subsrf = Isotrim(Surface=srf_canopy_2, Domain=dom²)
map_srf = MapToSurface(Curve=crv_base_2, Source=srf, Target=subsrf)
crvs_mapped = Data(map_srf)
member_depth = Slider(5, range=0..6)
member_width = Slider(1, range=0..6)
srf_canopy_3 = Data(srf_canopy)
crvs_mapped_2 = Data(crvs_mapped)
end = EndPoints(Curve=crvs_mapped_2)  # -> Start, End
member_depth_2 = Data(member_depth)
member_width_2 = Data(member_width)
srf_cp = SurfaceClosestPoint(Point=end.Start, Surface=srf_canopy_3)  # -> Point, UVPoint, Distance
evalsrf = EvaluateSurface(Surface=srf_canopy_3, Point=srf_cp.UVPoint)  # -> Point, Normal, UDirection, VDirection, Frame
division_4 = Division(A=member_width_2, B="2")
deplane = DeconstructPlane(Plane=evalsrf.Frame)  # -> Origin, XAxis, YAxis, ZAxis
amp = Amplitude(Vector=deplane.XAxis, Amplitude=division_4)
amp_2 = Amplitude(Vector=deplane.ZAxis, Amplitude=member_depth_2)
neg_2 = Negative(Value=amp_2)
neg_3 = Negative(Value=amp)
move_7 = Move(Geometry=deplane.Origin, Motion=neg_2)  # -> Geometry, Transform
move_8 = Move(Geometry=deplane.Origin, Motion=neg_3)  # -> Geometry, Transform
move_9 = Move(Geometry=deplane.Origin, Motion=amp)  # -> Geometry, Transform
rec_3pt = Rectangle3Pt(PointA=move_9.Geometry, PointB=move_8.Geometry, PointC=move_7.Geometry)  # -> Rectangle, Length
srf_2 = Surface(rec_3pt.Rectangle)
swp1 = Sweep1(Rail=graft(crvs_mapped_2), Sections=graft(srf_2), Miter=0)  # -> flatten(Brep)
cache = ContentCache(Content=swp1, Action=Toggle(True))
